# Grasshopper definition basic-cs-component.gh (Grasshopper 1.0.7)

height = Slider(7, range=0..10)  # disabled
radius = Slider(8, range=0..10)  # disabled
number_slider = Slider(0.5, range=0..1)  # disabled
number_slider_2 = Slider(0, range=0..1)  # disabled
number_slider_3 = Slider(1, range=0..1)  # disabled
number_slider_4 = Slider(14, range=1..100)  # disabled
number_slider_5 = Slider(9.6, range=1..100)  # disabled
controlpoints = Point([Point(-23.03115994, 9.846206859, 0), Point(-15.49753734, -23.11339202, 0), Point(2.394816333, 17.85068087, 0), Point(11.34099317, -12.75466094, 0), Point(21.69972425, 10.55248398, 0), Point(30.41047538, 38.80356873, 0), Point(-5.138806268, 52.92911111, 0), Point(-51.04681899, 39.98069726, 0), Point(-55.75533312, 20.44036364, 0), Point(-45.86745345, -8.987849643, 0)])
boolean_toggle = BooleanToggle(True)  # disabled
point = Point([Point(54.32033387, 37.35023927, 0), Point(10.95109659, -3.205336866, 22.91179764), Point(0, -1.503648463, 9.255571295), Point(0, -9.549398955, -4.064615966), Point(0, -1.028396811, -8.472030868), Point(25.69049546, 1.948927784, 37.85694524), Point(6.641447727, 0, 29.84844269), Point(-109.4830135, -101.6425078, 0)])  # disabled
reset = Button()  # disabled
button = Button()  # disabled
timer = Timer(TimerInterval=20, Target=moving_polyline)  # disabled
_2nd_degree_nurbs_curve = CSharpScript(controlPoints=controlpoints, iterationCount=Slider(10, range=0..10))  # -> out, curve; inputs controlPoints: list of Point3d, iterationCount: Int32
# ---------- _2nd_degree_nurbs_curve: C# ----------
    for (int j = 0; j < iterationCount; j++)
    {

      List<Point3d> newControlPoints = new List<Point3d>();

      for (int i = 0; i < controlPoints.Count - 1; i++)
      {
        Point3d oneQuarterPoint = 0.75 * controlPoints[i] + 0.25 * controlPoints[i + 1];
        newControlPoints.Add(oneQuarterPoint);

        Point3d threeQuarterPoint = 0.25 * controlPoints[i] + 0.75 * controlPoints[i + 1];
        newControlPoints.Add(threeQuarterPoint); 
      }

      controlPoints = newControlPoints;
    }

    curve = new PolylineCurve(controlPoints);
# ---------- end _2nd_degree_nurbs_curve ----------
moving_polyline = CSharpScript(reset=boolean_toggle, magnifier=number_slider_5, snakeLength=number_slider_4)  # -> out, A; inputs reset: Boolean, magnifier: Double, snakeLength: Double; disabled
# ---------- moving_polyline: C# ----------
    if(positions.Count > snakeLength)
    {
      for(int i = 0; i < positions.Count - snakeLength + 1; i++)
      {
        positions.RemoveAt(0);
      }
    }


    if(reset == true)
    {
      position = new Point3d(0, 0, 0);
      positions = new List<Point3d>();
    }
    else
    {
      double myRandomy = (myRandomGenerator.NextDouble() - 0.5) * magnifier;
      double myRandomx = (myRandomGenerator.NextDouble() - 0.5) * magnifier;
      double myRandomz = (myRandomGenerator.NextDouble() - 0.5) * magnifier;
      position += new Vector3d(myRandomx, myRandomy, myRandomz);
      positions.Add(position);


    }

    A = positions;
# ---------- moving_polyline: C# additional code ----------
  Point3d position = new Point3d(0, 0, 0);
  Random myRandomGenerator = new Random();
  List<Point3d> positions = new List<Point3d>();
  double myRandomxOld = 0.0;
  double myRandomyOld = 0.0;
  double myRandomzOld = 0.0;
# ---------- end moving_polyline ----------
random_points = CSharpScript(iCount=Slider(280, range=2..500))  # -> out, oPoints; inputs iCount: Int32
# ---------- random_points: C# ----------
    Random myRandomGenerator = new Random();
    List<Point3d> points = new List<Point3d>();


    for (int i = 0; i < iCount; i++)
    {
      double myRandomy = (myRandomGenerator.NextDouble() - 0.5) * 20;
      double myRandomx = (myRandomGenerator.NextDouble() - 0.5) * 20;
      Point3d myRandomPoint = new Point3d(myRandomx, myRandomy, 0.0);
      points.Add(myRandomPoint);
    }

    oPoints = points;
# ---------- end random_points ----------
foreach = CSharpScript(points=point)  # -> out, A; inputs points: list of Point3d; disabled
# ---------- foreach: C# ----------
    List<Circle> myCircles = new List<Circle>();

    foreach (Point3d point in points)
    {
      Circle circle = new Circle(point, 10.0);
      myCircles.Add(circle);
    }
    
    A = myCircles;
# ---------- end foreach ----------
c_script = CSharpScript(plusOne=button, reset=reset)  # -> out, A; inputs plusOne: Boolean, reset: Boolean; disabled
# ---------- c_script: C# ----------
    if(plusOne == true)
    {
      n += 1;
    }

    if(reset == true)
    {
      n = 0;
    }
    Print(n.ToString());
# ---------- c_script: C# additional code ----------
  int n = 0;
# ---------- end c_script ----------
function_cylindervolume = CSharpScript(radius=radius, height=height)  # -> out, A; inputs radius: Double, height: Double; disabled
# ---------- function_cylindervolume: C# ----------
    A = ComputeCylinderVolume(radius, height);
    Print(ComputeCylinderVolume(1.0, 8.0).ToString());
# ---------- function_cylindervolume: C# additional code ----------
  double ComputeCylinderVolume(double r, double h)
  {
    return 3.14 * r * r * h;
  }
# ---------- end function_cylindervolume ----------
some_beginner_stuff = CSharpScript(x1=number_slider, x2=number_slider_2, x3=number_slider_3)  # -> out, A, B, C; inputs x1: Double, x2: Double, x3: Double; disabled
# ---------- some_beginner_stuff: C# ----------
    Point3d p1 = new Point3d(x1, x2, x3);
    Point3d p2 = new Point3d(x2, x3, x1);
    Point3d p3 = new Point3d(x3, x1, x2);
    A = p1;
    B = p2;
    C = p3;
    Print(x1.ToString());
    Print(" ");

    for (int i = 0; i < 3; i++)
    {
      Print(i.ToString());
      RhinoApp.WriteLine(i.ToString());
    }
    Print(" ");

    List<double> myNumbers = new List<double>(){0.5,3.14,x1,x2,x3};
    Print(myNumbers.ToString());
# ---------- end some_beginner_stuff ----------
for_loop_and_list = CSharpScript()  # -> out, A; disabled
# ---------- for_loop_and_list: C# ----------
    List<Point3d> myPoints = new List<Point3d>();

    for(int i = 0; i < 100; i++)
    {
      for(int j = 0; j < 20; j++)
      {
        myPoints.Add(new Point3d(j * 2, i, j * 0.4));
      }
    }



    A = myPoints;
# ---------- end for_loop_and_list ----------
timer_2 = Timer(TimerInterval=20, Target=relaxation)  # disabled
number_slider_6 = Slider(0.09, range=0.01..1)  # disabled
polyline = PolyLine(Vertices=moving_polyline.A, Closed=False)  # disabled
panel = Panel(c_script.out)  # disabled
panel_2 = Panel(function_cylindervolume.A)  # disabled
curve = Curve(reparameterize(_2nd_degree_nurbs_curve.curve))  # disabled
relaxation = CSharpScript(reset=Button(), iStartingPoints=random_points.oPoints)  # -> out, oGeometry; inputs reset: Boolean, iStartingPoints: list of Point3d
# ---------- relaxation: C# ----------
    if (reset == true)
    {
      centers = new List<Point3d>(iStartingPoints);
    }

      List<Vector3d> totalMoves = new List<Vector3d>();
      List<double> collisionCounts = new List<double>();

      for (int i = 0; i < centers.Count; i++)
      {
        totalMoves.Add(new Vector3d(0, 0, 0));
        collisionCounts.Add(0.0);
      }

      double collisionDistance = 2.0;

      for (int i = 0; i < centers.Count; i++)
      {
        for (int j = i + 1; j < centers.Count; j++)
        {
          double d = centers[i].DistanceTo(centers[j]);
          if (d > collisionDistance) continue;

          Vector3d move = centers[i] - centers[j];
          move.Unitize();
          move *= 0.5 * (collisionDistance - d);

          totalMoves[i] += move;
          totalMoves[j] -= move;
          collisionCounts[i] += 1.0;
          collisionCounts[j] = +1.0;
        }
      }

      for (int i = 0; i < centers.Count; i++)
      {
        if (collisionCounts[i] > 0.5)
        {
          Vector3d averageMove = totalMoves[i] / collisionCounts[i];
          centers[i] += averageMove;
        }
        else
        {
          Vector3d averageMove = totalMoves[i];
          centers[i] += averageMove;
        }
      }

    oGeometry = centers;
# ---------- relaxation: C# additional code ----------
  List<Point3d> centers;
# ---------- end relaxation ----------
panel_3 = Panel(some_beginner_stuff.out)  # disabled
panel_4 = Panel([some_beginner_stuff.A, some_beginner_stuff.B, some_beginner_stuff.C])  # disabled
decasteljau = CSharpScript(curve=curve, tolerance=number_slider_6)  # -> out, outputSegments; inputs curve: Curve, tolerance: Double; disabled
# ---------- decasteljau: C# ----------
    List<LineCurve> segments = new List<LineCurve>();
    DivideCurve(curve, 0.0, 1.0, tolerance, segments);
    outputSegments = segments;
# ---------- decasteljau: C# additional code ----------
  void DivideCurve(Curve curve, double tStart, double tEnd, double tolerance, List<LineCurve> segments)
  {
    Point3d startPoint = curve.PointAt(tStart);
    Point3d endPoint = curve.PointAt(tEnd);
    Point3d middlePoint = 0.5 * (startPoint + endPoint);

    double tClosest;
    curve.ClosestPoint(middlePoint, out tClosest);

    double distance = curve.PointAt(tClosest).DistanceTo(middlePoint);

    if (distance < tolerance)
    {
      segments.Add(new LineCurve(startPoint, endPoint));
    }
    else
    {
      double tMiddle = 0.5 * (tStart + tEnd);
      DivideCurve(curve, tStart, tMiddle, tolerance, segments);
      DivideCurve(curve, tMiddle, tEnd, tolerance, segments);

    }
  }
# ---------- end decasteljau ----------
circle_cnr = CircleCNR(Center=relaxation.oGeometry, Normal=Vector(0, 0, 1), Radius=1)
