# Grasshopper definition temp.gh (Grasshopper 1.0.7)
# plug-ins: GHPlugin

vec = VectorXYZ(XComponent=Slider(1, range=-1..1), YComponent=Slider(0.1, range=-1..1), ZComponent=Slider(0, range=-1..1))  # -> Vector, Length
timer = Timer(TimerInterval=20, Target=moving_particle)
moving_particle = MovingParticle(Reset=Button(), Velocity=vec.Vector)
