# Grasshopper definition GenericGrasshopperScript.gh (Grasshopper 1.0.7)

number_slider = Slider(0, range=0..10)
number_slider_2 = Slider(0, range=0..10)
number_slider_3 = Slider(0, range=0..10)
force_direction = Slider(0, range=-1..1)
force_direction_2 = Slider(0, range=-1..1)
force_direction_3 = Slider(-0.5, range=-1..1)
main_support_direction = Slider(0, range=-1..1)
main_support_direction_2 = Slider(0, range=-1..1)
main_support_direction_3 = Slider(0, range=-1..1)
main_direction = BooleanToggle(True)
secondary_direction = BooleanToggle(True)
rotation = BooleanToggle(False)
main_direction_2 = BooleanToggle(True)
secondary_direction_2 = BooleanToggle(False)
main_direction_3 = BooleanToggle(False)
secondary_direction_3 = BooleanToggle(False)
rotation_2 = BooleanToggle(False)
rotation_3 = BooleanToggle(False)

integer = Integer([Slider(0, range=0..10), Slider(2, range=0..10)])
integer_2 = Integer(Slider(1, range=0..10))
number = Number(force_direction)
factor = Factor(-1)
unit_y = UnitY(Factor=factor)
unit_z = UnitZ(Factor=1)
pi = Pi(Factor=number)
number_2 = Number([main_support_direction_3, main_support_direction])
factor_2 = Factor(-1)
unit_y_2 = UnitY(Factor=factor_2)
unit_z_2 = UnitZ(Factor=1)
pi_2 = Pi(Factor=number_2)
rotate = Rotate(Vector=unit_y, Axis=unit_z, Angle=pi)
rotate_2 = Rotate(Vector=unit_y_2, Axis=unit_z_2, Angle=pi_2)
boolean = Boolean([rotation, rotation_2])
boolean_2 = Boolean([secondary_direction, secondary_direction_2])
boolean_3 = Boolean([main_direction, main_direction_2])
boolean_4 = Boolean([main_direction, main_direction_2])
integer_3 = Integer([boolean_4, boolean_2, boolean])
mass_addition = MassAddition(Input=integer_3)  # -> Result, PartialResults

form_lines = Curve(<curve referenced from the Rhino model>)

explode = Explode(Curve=form_lines, Recursive=True)  # -> Segments, Vertices
end_points = EndPoints(Curve=explode.Segments)  # -> Start, End
cull_duplicates = CullDuplicates(Points=[end_points.Start, end_points.End], Tolerance=0.1, CullMode=3)  # -> Points, Indices, Valence
list_length = ListLength(List=explode.Segments)

nodes = Point(cull_duplicates.Points)

list_item = ListItem(List=nodes, Index=integer, Wrap=True)
list_item_2 = ListItem(List=nodes, Index=integer_2, Wrap=True)

force_application_point = Point(list_item_2)
supports = Point(list_item)

line_sdl = LineSDL(Start=force_application_point, Direction=rotate, Length=1)
line_sdl_2 = LineSDL(Start=supports, Direction=rotate_2, Length=1)
list_length_2 = ListLength(List=nodes)
c_script = CSharpScript(m=list_length, r=list_length_2, j=mass_addition.Result)  # -> out, A; inputs m: Int32, r: Int32, j: Int32
# ---------- c_script: C# ----------
   int i = m + r - 2 * j;
    A = i;
# ---------- end c_script ----------
panel = Panel(c_script.A)
